# Grasshopper definition Parametric christmas tree by DyvikDesign.gh (Grasshopper 0.8.52)

timer = Timer(TimerInterval=10, Target=skeleton)
skeleton = KinectSkeletalViewer(SkeletonScaleFactor=Slider(1000, range=0..1000), TranslateInZAxis=0)  # -> Points, JointID, Bones
no_of_branches = Slider(6, range=2..8)
kinect_heigth = Slider(1000, range=0..1000)
material_thickness_mm = Slider(3, range=0..22)
tolerance = Slider(-0.05, range=-1..1)
scale_1 = Slider(10, range=1..20)
branch_width = Slider(0.831, range=0..2)
star_outer_radius = Slider(0.043, range=0..1)
star_inner_radius = Slider(0.143, range=0..1)
branch_growth = Slider(1.18, range=0..2)
branch_direction = Slider(-0.165, range=-1..1)
branch_width_growth = Slider(0.064, range=0..1)
star_height = Slider(0.086, range=0..1)
Z = UnitZ(Factor=kinect_heigth)
move = Move(Geometry=skeleton.Points, Translation=Z)  # -> Geometry, Transform
item = ListItem(List=move.Geometry, Index=1, Wrap=False)
item_2 = ListItem(List=move.Geometry, Index=11, Wrap=False)
item_3 = ListItem(List=move.Geometry, Index=19, Wrap=False)
item_4 = ListItem(List=move.Geometry, Index=7, Wrap=False)
pt = Point(<point referenced from the Rhino model>)
pt_2 = Point(<point referenced from the Rhino model>)
item_5 = ListItem(List=move.Geometry, Index=15, Wrap=False)
pt_3 = Point(<point referenced from the Rhino model>)
pt_4 = Point(<point referenced from the Rhino model>)
pt_5 = Point(item)
pt_6 = Point(item_2)
pt_7 = Point(<point referenced from the Rhino model>)
pt_8 = Point(item_3)
series = Series(Start=0, Step=1, Count=no_of_branches)
pcomp = Decompose(Point=pt_6)  # -> XComponent, YComponent, ZComponent
pt_9 = Point(item_4)
series_2 = Series(Start=0, Step=1, Count=no_of_branches)
pt_10 = Point(item_5)
pcomp_2 = Decompose(Point=pt_5)  # -> XComponent, YComponent, ZComponent
pcomp_3 = Decompose(Point=pt_8)  # -> XComponent, YComponent, ZComponent
division = Division(A=material_thickness_mm, B=2)
series_3 = Series(Start=0, Step=1, Count=no_of_branches)
pcomp_4 = Decompose(Point=pt_10)  # -> XComponent, YComponent, ZComponent
pcomp_5 = Decompose(Point=pt_9)  # -> XComponent, YComponent, ZComponent
pcomp_6 = Decompose(Point=pt_5)  # -> XComponent, YComponent, ZComponent
series_4 = Series(Start=0, Step=1, Count=no_of_branches)
division_2 = Division(A=pcomp.ZComponent, B=scale_1)
subtraction = Subtraction(A=pcomp.XComponent, B=pcomp_2.XComponent)
subtraction_2 = Subtraction(A=pcomp_3.XComponent, B=pcomp_2.XComponent)
pow = Power(A=series, B=branch_growth)
division_3 = Division(A=material_thickness_mm, B=2)
division_4 = Division(A=pcomp_2.ZComponent, B=scale_1)
division_5 = Division(A=subtraction_2, B=scale_1)
subtraction_3 = Subtraction(A=pcomp_4.XComponent, B=pcomp_6.XComponent)
addition = Addition(A=division, B=tolerance)
pow_2 = Power(A=series_2, B=branch_width)
subtraction_4 = Subtraction(A=pcomp_5.XComponent, B=pcomp_6.XComponent)
division_6 = Division(A=pcomp_5.ZComponent, B=scale_1)
division_7 = Division(A=subtraction, B=scale_1)
pow_3 = Power(A=series_3, B=branch_growth)
pt_11 = PointXYZ(XComponent=division_5, YComponent=0, ZComponent=0)
division_8 = Division(A=pcomp_6.ZComponent, B=scale_1)
division_9 = Division(A=subtraction_3, B=scale_1)
addition_2 = Addition(A=division_3, B=tolerance)
pow_4 = Power(A=series_4, B=branch_width)
rev = ReverseList(List=pow)
pt_12 = PointXYZ(XComponent=addition, YComponent=0, ZComponent=division_4)
division_10 = Division(A=subtraction_4, B=scale_1)
pt_13 = PointXYZ(XComponent=division_7, YComponent=0, ZComponent=division_2)
neg = Negative(Input=addition_2)
pt_14 = PointXYZ(XComponent=division_9, YComponent=0, ZComponent=0)
pt_15 = PointXYZ(XComponent=neg, YComponent=0, ZComponent=division_8)
item_6 = ListItem(List=rev, Index=0, Wrap=False)
rev_2 = ReverseList(List=pow_3)
crv = Curve(Vertices=[pt_12, pt_13, pt_11], Degree=3, Periodic=False)  # -> Curve, Length, Domain
pt_16 = PointXYZ(XComponent=division_10, YComponent=0, ZComponent=division_6)
vec2pt = Vector2Pt(PointA=pt_12, PointB=pt_11, Unitize=False)  # -> Vector, Length
item_7 = ListItem(List=rev_2, Index=0, Wrap=False)
len = Length(Curve=crv.Curve)
multiplication = Multiplication(A=len, B=branch_width_growth)
crv_2 = Curve(Vertices=[pt_15, pt_16, pt_14], Degree=3, Periodic=False)  # -> Curve, Length, Domain
multiplication_2 = Multiplication(A=pow_2, B=multiplication)
division_11 = Division(A=len, B=item_6)
vec2pt_2 = Vector2Pt(PointA=pt_15, PointB=pt_14, Unitize=False)  # -> Vector, Length
len_2 = Length(Curve=crv_2.Curve)
multiplication_3 = Multiplication(A=len_2, B=branch_width_growth)
multiplication_4 = Multiplication(A=pow_4, B=multiplication_3)
division_12 = Division(A=len_2, B=item_7)
multiplication_5 = Multiplication(A=pow, B=division_11)
amp = Amplitude(Vector=vec2pt.Vector, Amplitude=multiplication_5)
move_2 = Move(Geometry=pt_12, Translation=amp)  # -> Geometry, Transform
multiplication_6 = Multiplication(A=pow_3, B=division_12)
amp_2 = Amplitude(Vector=vec2pt_2.Vector, Amplitude=multiplication_6)
multiplication_7 = Multiplication(A=multiplication_2, B=branch_direction)
move_3 = Move(Geometry=pt_15, Translation=amp_2)  # -> Geometry, Transform
crv_cp = CurveCP(Point=move_2.Geometry, Curve=crv.Curve)  # -> Point, Parameter, Distance
multiplication_8 = Multiplication(A=multiplication_4, B=branch_direction)
crv_cp_2 = CurveCP(Point=move_3.Geometry, Curve=crv_2.Curve)  # -> Point, Parameter, Distance
Z_2 = UnitZ(Factor=multiplication_7)
X = UnitX(Factor=multiplication_2)
X_2 = UnitX(Factor=multiplication_4)
Z_3 = UnitZ(Factor=multiplication_8)
move_4 = Move(Geometry=crv_cp.Point, Translation=X)  # -> Geometry, Transform
rev_3 = Reverse(Vector=X_2)
move_5 = Move(Geometry=crv_cp_2.Point, Translation=rev_3)  # -> Geometry, Transform
move_6 = Move(Geometry=move_4.Geometry, Translation=Z_2)  # -> Geometry, Transform
move_7 = Move(Geometry=move_5.Geometry, Translation=Z_3)  # -> Geometry, Transform
cull_i = CullIndex(List=move_6.Geometry, Indices=0, Wrap=False)
weave = Weave(Pattern=[0, 1], Stream0=crv_cp.Point, Stream1=cull_i, NullGaps=False)
cull_i_2 = CullIndex(List=move_7.Geometry, Indices=0, Wrap=False)
weave_2 = Weave(Pattern=[0, 1], Stream0=crv_cp_2.Point, Stream1=cull_i_2, NullGaps=False)
pline = PolyLine(Vertices=weave, Closed=False)
pline_2 = PolyLine(Vertices=weave_2, Closed=False)
division_13 = Division(A=division_4, B=2)
addition_3 = Addition(A=tolerance, B=division_13)
neg_2 = Negative(Input=addition_3)
Z_4 = UnitZ(Factor=neg_2)
rev_4 = ReverseList(List=crv_cp_2.Point)
rev_5 = ReverseList(List=crv_cp.Point)
move_8 = Move(Geometry=pt_15, Translation=Z_4)  # -> Geometry, Transform
move_9 = Move(Geometry=pt_12, Translation=Z_4)  # -> Geometry, Transform
item_8 = ListItem(List=rev_4, Index=0, Wrap=False)
item_9 = ListItem(List=rev_5, Index=0, Wrap=False)
pt_17 = Point(flatten(move_8.Geometry))
pt_18 = Point(flatten(pt_12))
pt_19 = Point(flatten(pt_15))
pt_20 = Point(flatten(move_9.Geometry))
ln = Line(PointA=item_9, PointB=item_8)
pt_21 = PointXYZ(XComponent=0, YComponent=0, ZComponent=division_13)
pline_3 = PolyLine(Vertices=[pt_18, pt_20, pt_17, pt_19], Closed=False)
xz = XZPlane(Origin=Point(0, 0, 0))
xy = XYPlane(Origin=pt_21)
multiplication_9 = Multiplication(A=len, B=star_outer_radius)
multiplication_10 = Multiplication(A=len, B=star_inner_radius)
multiplication_11 = Multiplication(A=material_thickness_mm, B=1.2)
mirror = Mirror(Geometry=pline_3, Plane=xy)  # -> Geometry, Transform
polygon = Polygon(Plane=xz, Radius=multiplication_9, Segments=5, FilletRadius=0)  # -> Polygon, Length
polygon_2 = Polygon(Plane=xz, Radius=multiplication_10, Segments=5, FilletRadius=0)  # -> Polygon, Length
neg_3 = Negative(Input=multiplication_11)
end = EndPoints(Curve=mirror.Geometry)  # -> Start, End
pt_22 = PointXYZ(XComponent=0, YComponent=0, ZComponent=division_4)
rad = Radians(Degrees=36)
ln_2 = Line(PointA=pt_18, PointB=pt_19)
ln_3 = Line(PointA=end.Start, PointB=item_9)
dom = Domain(DomainStart=neg_3, DomainEnd=multiplication_11)
ln_4 = Line(PointA=end.End, PointB=item_8)
xz_2 = XZPlane(Origin=pt_22)
rotate = Rotate(Geometry=polygon_2.Polygon, Angle=rad, Plane=xz)  # -> Geometry, Transform
multiplication_12 = Multiplication(A=len, B=star_height)
join = JoinCurves(Curves=flatten([ln, pline_2, pline_3, pline]), Preserve=False)
explode = Explode(Curve=polygon.Polygon, Recursive=True)  # -> Segments, Vertices
explode_2 = Explode(Curve=rotate.Geometry, Recursive=True)  # -> Segments, Vertices
neg_4 = Negative(Input=multiplication_12)
end_2 = EndPoints(Curve=explode.Segments)  # -> Start, End
end_3 = EndPoints(Curve=explode_2.Segments)  # -> Start, End
dom_2 = Domain(DomainStart=multiplication_12, DomainEnd=neg_4)
rad_2 = Radians(Degrees=Slider(54, range=0..100))
join_2 = JoinCurves(Curves=flatten([ln_4, ln_3, mirror.Geometry, pline_2, pline, ln_2]), Preserve=False)
addition_4 = Addition(A=multiplication_12, B=division_4)
weave_3 = Weave(Pattern=[0, 1], Stream0=end_2.Start, Stream1=end_3.Start, NullGaps=False)
rev_6 = ReverseList(List=cull_i)
rev_7 = ReverseList(List=cull_i_2)
pline_4 = PolyLine(Vertices=weave_3, Closed=True)
Z_5 = UnitZ(Factor=addition_4)
rotate_2 = Rotate(Geometry=pline_4, Angle=rad_2, Plane=xz)  # -> Geometry, Transform
item_10 = ListItem(List=rev_6, Index=0, Wrap=False)
rectangle = Rectangle(Plane=xz_2, XSize=dom, YSize=dom_2, Radius=0)  # -> Rec, Length
item_11 = ListItem(List=rev_7, Index=0, Wrap=False)
dist = Distance(PointA=item_10, PointB=item_11)
move_10 = Move(Geometry=rotate_2.Geometry, Translation=Z_5)  # -> Geometry, Transform
runion = RegionUnion(Curves=flatten([join_2, move_10.Geometry, rectangle.Rec]))
multiplication_13 = Multiplication(A=dist, B=Slider(1.302, range=0..2))
multiplication_14 = Multiplication(A=multiplication_13, B=2)
X_3 = UnitX(Factor=multiplication_13)
X_4 = UnitX(Factor=multiplication_14)
division_14 = Division(A=material_thickness_mm, B=2)
neg_5 = Negative(Input=X_3)
neg_6 = Negative(Input=X_4)
Y = UnitY(Factor=material_thickness_mm)
Y_2 = UnitY(Factor=division_14)
neg_7 = Negative(Input=Y)
move_11 = Move(Geometry=runion, Translation=Y_2)  # -> Geometry, Transform
move_12 = Move(Geometry=runion, Translation=Y_2)  # -> Geometry, Transform
extr = Extrude(Base=join, Direction=neg_7)
rad_3 = Radians(Degrees=90)
xy_2 = XYPlane(Origin=Point(0, 0, 0))
extr_2 = Extrude(Base=move_11.Geometry, Direction=neg_7)
cap = CapHoles(Brep=extr)
# Bake these
move_13 = Move(Geometry=join, Translation=neg_5)  # -> Geometry, Transform
rotate_3 = Rotate(Geometry=cap, Angle=rad_3, Plane=xy_2)  # -> Geometry, Transform
move_14 = Move(Geometry=runion, Translation=neg_6)  # -> Geometry, Transform
cap_2 = CapHoles(Brep=extr_2)
